# Grasshopper definition revitPlanToGrid.gh (Grasshopper 1.0.7)
# plug-ins: Rhino.Inside for Autodesk Revit, PTComponentLibrary, Eelish, Human UI

# ---- group: humanUI
true_button = CreateTrueOnlyButton(ButtonName="Settings", ButtonStyle=0)
values = ValueListener(Elements=true_button, SomeProperty=True)  # -> Values, Indices
adjustpos = AdjustElementPositioning(
    ElementsToAdjust=true_button,
    AbsolutePositioning="True",
    HorizontalAlignment=Slider(2, range=0..10),
    VerticalAlignment=Slider(10, range=0..10))

# ----
toggle = CreateToggle(Default=Toggle(False), Label="Read solution grid")

# ---- group: humanUI
# Run tab
panel = Panel("--------------------")
panel_2 = Panel("""Welcome to CLT designer
----------

Lorem ipsum



Revit walls fetched based on type""")
mdv = CreateMarkdownViewer(Text=panel)
mdv_2 = CreateMarkdownViewer(Text=panel_2)
filepicker = CreateFilePicker(ButtonLabelText="Main folder", DialogType="2", MustExist=True, Filter="All Files|*.*")
textbox = CreateTextBox(Label="CLT slab widths", DefaultText="2,3", UpdateButton=Toggle(True), showLabel=True)
textbox_2 = CreateTextBox(Label="CLT slab hights", DefaultText="8,9,16", UpdateButton=Toggle(True), showLabel=True)
textbox_3 = CreateTextBox(Label="Population size", DefaultText="20", UpdateButton=Toggle(True), showLabel=True)
textbox_4 = CreateTextBox(Label="Number of generations", DefaultText="30", UpdateButton=Toggle(True), showLabel=True)
tb = CreateTextBlock(Text="Status", TextSize=12, Justification=0)
toggle_2 = CreateToggle(Default=Toggle(False), Label="Write grid and slab files")
toggle_3 = CreateToggle(Default=Toggle(False), Label="Run genetic algorithm")
toggle_4 = CreateToggle(Default=Toggle(False), Label="Introduce additional beams as mutations?")
values_2 = ValueListener(Elements=filepicker, SomeProperty=True)  # -> Values, Indices
values_3 = ValueListener(Elements=textbox, SomeProperty=True)  # -> Values, Indices
values_4 = ValueListener(Elements=textbox_2, SomeProperty=True)  # -> Values, Indices
values_5 = ValueListener(Elements=toggle_2, SomeProperty=True)  # -> Values, Indices
panel_3 = Panel(values_2.Values)
values_6 = ValueListener(Elements=toggle_3, SomeProperty=True)  # -> Values, Indices
values_7 = ValueListener(Elements=toggle_4, SomeProperty=True)  # -> Values, Indices
split = TextSplit(Text=values_3.Values, Separators=",")
split_2 = TextSplit(Text=values_4.Values, Separators=",")
merge = Merge(
    Data1=true_button,
    Data3=mdv_2,
    Data4=mdv,
    Data5=filepicker,
    Data6=textbox,
    Data7=textbox_2,
    Data8=textbox_4,
    Data9=textbox_3,
    Data10=toggle_4,
    Data11=toggle_2,
    Data12=toggle_3,
    Data13=mdv,
    Data14=toggle,
    Data15=tb)

# ----
values_8 = ValueListener(Elements=textbox_4, SomeProperty=True)  # -> Values, Indices
values_9 = ValueListener(Elements=textbox_3, SomeProperty=True)  # -> Values, Indices
values_10 = ValueListener(Elements=toggle, SomeProperty=True)  # -> Values, Indices

# ---- group: humanUI
# Launch Window
pan = Panel("Genetic algorithm for CLT slab layout")
launchwin = LaunchWindow(Show=Toggle(True), Name=pan, Width="425", Height="750", ChildStatus=1, EnableHorizScroll=False)
addelems = AddElements(Window=launchwin, Elements=flatten(merge), DoVLChecking=True)  # -> AddedElements, ElementNames

# ---- group: do not touch
# HIDING GRASSHOPPER
panel_4 = Panel("show grasshopper")
toggle_5 = CreateToggle(Default="True", Label="Grasshopper", OnLabel="hide grasshopper", OffLabel=panel_4)
values_11 = ValueListener(Elements=toggle_5, SomeProperty=True)  # -> Values, Indices
neg = Negative(Value=values_11.Values)
panel_5 = Panel(values_11.Values)
c_script = CSharpScript(x=neg)  # -> out, A; inputs x: Boolean
# ---------- c_script: C# ----------
    if (x == false)
    {
      Grasshopper.Instances.DocumentEditor.WindowState = FormWindowState.Minimized;
    }
    else
    {
      Grasshopper.Instances.DocumentEditor.WindowState = FormWindowState.Maximized;
    }
# ---------- end c_script ----------

# ---- group: humanUI
launchwin_2 = LaunchWindow(Show=values.Values, Name="SETTINGS", Width="425", Height="350", ChildStatus=1, EnableHorizScroll=False)
addelems_2 = AddElements(Window=launchwin_2, Elements=flatten(toggle_5), DoVLChecking=True)  # -> AddedElements, ElementNames
childwin = MakeChildWindow(ParentWindow=launchwin, ChildWindow=launchwin_2)

# ---- group: Check wall code
kolonne = Slider(0, range=0..47)
række = Slider(0, range=0..25)

# ----
slabs = Panel(split_2)
slabs_2 = Panel(split)

# ----
# slab sizes
lng = ListLength(List=slabs)
lng_2 = ListLength(List=slabs_2)
multiplication = Multiplication(A=lng, B=lng_2)
repeat = RepeatData(Data=graft(slabs_2), Length=lng)  # -> flatten(Data)
repeat_2 = RepeatData(Data=slabs, Length=multiplication)  # -> flatten(Data)
merge_2 = Merge(Data1=graft(repeat), Data2=graft(repeat_2))

# ---- group: change to absolute fingrid path
path = FilePath("C:\Users\marti\Documents\CN3 specialprojekt\RevitTests\fingridRevitGH.json")

# ---- group: run when place CLT slabs is finished
# 3.
toggle_6 = BooleanToggle(True)

# ----
# Revit walls to curves
model = ModelCategoriesPicker({"Air Systems": -2001008, "Air Terminals": -2008013, "Analysis Display Style": -2000304, "Analysis Results": -2000303, "Areas": -2003200, "Bridge Abutments": -2006130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}, selected="Walls": -2000011)
elementtype_picker = ElementTypePicker(
    model,
    {"Basic Wall : Exterior - Brick and CMU on MTL. Stud": "716d9086-a8c1-4ff4-bc48-fb2624b16dcc-22408d62-e4e7-4b75-9b8b-a2a157a1c32f-0000b915", "Basic Wall : Exterior - Brick on CMU": "716d9086-a8c1-4ff4-bc48-fb2624b16dcc-933c54e0-93b8-11d3-80f8-00c04f8efc32-000000fa", "Basic Wall : Exterior - Brick on Mtl. Stud": "716d9086-a8c1-4ff4-bc48-fb2624b16dcc-933c4a06-93b8-11d3-80f8-00c04f8efc32-000000dd", "Basic Wall : Exterior - CMU Insulated": "716d9086-a8c1-4ff4-bc48-fb2624b16dcc-933c54e1-93b8-11d3-80f8-00c04f8efc32-00000100", "Basic Wall : Exterior - CMU on Mtl. Stud": "716d9086-a8c1-4ff4-bc48-fb2624b16dcc-fcb996df-2e6e-4994-b4be-7b0dbb166632-000144e3", "Basic Wall : Exterior - EIFS on Mtl. Stud": "716d9086-a8c1-4ff4-bc48-fb2624b16dcc-b0ff411e-93b6-11d3-80f8-00c04f8efc32-00000108"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}, selected="Basic Wall : Generic - 8": "716d9086-a8c1-4ff4-bc48-fb2624b16dcc-933c54e0-93b8-11d3-80f8-00c04f8efc32-000000f9")
elementtype_picker_2 = ElementTypePicker(
    model,
    {"Basic Wall : Exterior - Brick and CMU on MTL. Stud": "716d9086-a8c1-4ff4-bc48-fb2624b16dcc-22408d62-e4e7-4b75-9b8b-a2a157a1c32f-0000b915", "Basic Wall : Exterior - Brick on CMU": "716d9086-a8c1-4ff4-bc48-fb2624b16dcc-933c54e0-93b8-11d3-80f8-00c04f8efc32-000000fa", "Basic Wall : Exterior - Brick on Mtl. Stud": "716d9086-a8c1-4ff4-bc48-fb2624b16dcc-933c4a06-93b8-11d3-80f8-00c04f8efc32-000000dd", "Basic Wall : Exterior - CMU Insulated": "716d9086-a8c1-4ff4-bc48-fb2624b16dcc-933c54e1-93b8-11d3-80f8-00c04f8efc32-00000100", "Basic Wall : Exterior - CMU on Mtl. Stud": "716d9086-a8c1-4ff4-bc48-fb2624b16dcc-fcb996df-2e6e-4994-b4be-7b0dbb166632-000144e3", "Basic Wall : Exterior - EIFS on Mtl. Stud": "716d9086-a8c1-4ff4-bc48-fb2624b16dcc-b0ff411e-93b6-11d3-80f8-00c04f8efc32-00000108"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}, selected="Basic Wall : Generic - 6": "716d9086-a8c1-4ff4-bc48-fb2624b16dcc-933c4a06-93b8-11d3-80f8-00c04f8efc32-000000db")
typefltr = TypeFilter(Types=elementtype_picker, Inverted=False)
typefltr_2 = TypeFilter(Types=elementtype_picker_2, Inverted=False)

# ---- group: inner bearing walls
elements = QueryElements(Filter=typefltr_2, Limit=100)  # -> Elements, Count

# ---- group: outer walls
elements_2 = QueryElements(Filter=typefltr, Limit=100)  # -> Elements, Count

# ----
location = ElementCurve(Element=elements_2.Elements)  # -> Element, Curve
location_2 = ElementCurve(Element=elements.Elements)  # -> Element, Curve
outer_curve = Curve(location.Curve)
all_wall_curves = Curve([location_2.Curve, location.Curve])
join = JoinCurves(Curves=outer_curve, Preserve=False)
ccrvgen = ClosedCurveGenerator(Curves=all_wall_curves)  # -> Rooms, Debug

bbox = BoundingBox(Content=join, Plane=PlaneXY(0, 0, 0))  # -> Box, Box_2
debox = DeconstructBox(Box=bbox.Box)  # -> Plane, X, Y, Z
dedomain = DeconstructDomain(Domain=debox.X)  # -> Start, End
dedomain_2 = DeconstructDomain(Domain=debox.Y)  # -> Start, End
pt = ConstructPoint(XCoordinate=dedomain.Start, YCoordinate=dedomain_2.Start, ZCoordinate=0)

boundary = BoundarySurfaces(Edges=join)
number_slider = Slider(1, range=0..100)
ptsrfdis = SurfaceDistance(Surface=boundary, U_dis=number_slider, V_dis=number_slider, Extend=Toggle(False), RefPt=pt)
ptfaces = GenerateFaces(Grid=ptsrfdis, PanelShape=Slider(0, range=0..3))
area = Area(Geometry=ptfaces)  # -> Area, Centroid
incurves = PointInCurves(Point=area.Centroid, Curves=join)  # -> Relationship, Index, Point

incurves_2 = PointInCurves(Point=ptsrfdis, Curves=ccrvgen.Rooms)  # -> Relationship, Index, Point
item = ListItem(List=incurves_2.Point, Index=expr("x+1", kolonne), Wrap=True)
item_2 = ListItem(List=incurves_2.Point, Index=expr("x+1", kolonne), Wrap=True)
item_3 = ListItem(List=incurves_2.Relationship, Index=expr("x+1", kolonne), Wrap=True)
item_4 = ListItem(List=incurves_2.Point, Index=kolonne, Wrap=True)
item_5 = ListItem(List=incurves_2.Relationship, Index=expr("x+1", kolonne), Wrap=True)
item_6 = ListItem(List=incurves_2.Point, Index=kolonne, Wrap=True)
item_7 = ListItem(List=incurves_2.Relationship, Index=kolonne, Wrap=True)
item_8 = ListItem(List=incurves_2.Relationship, Index=kolonne, Wrap=True)
gradient = Gradient(
    LowerLimit="0",
    UpperLimit="2",
    Parameter=incurves_2.Relationship,
    stops=[0: RGB(5, 92, 123), 0: RGB(251, 1, 15), 0: RGB(61, 148, 245), 0.525: RGB(255, 130, 160), 0.974: RGB(16, 218, 33)])
pt_2 = Point(incurves_2.Point)
item_9 = ListItem(List=flatten(item), Index=række, Wrap=True)
item_10 = ListItem(List=flatten(item_2), Index=expr("x+1", række), Wrap=True)
item_11 = ListItem(List=flatten(item_6), Index=expr("x+1", række), Wrap=True)
item_12 = ListItem(List=flatten(item_4), Index=række, Wrap=True)
item_13 = ListItem(List=flatten(item_3), Index=række, Wrap=True)
item_14 = ListItem(List=flatten(item_8), Index=expr("x+1", række), Wrap=True)
item_15 = ListItem(List=flatten(item_5), Index=expr("x+1", række), Wrap=True)
item_16 = ListItem(List=flatten(item_7), Index=række, Wrap=True)
preview = CustomPreview(Geometry=pt_2, Material=gradient)
preview_2 = CustomPreview(Geometry=[item_12, item_9, item_11, item_10], Material=ColourSwatch(SwatchColor=RGB(247, 2, 141)))

item_17 = ListItem(List=incurves.Point, Index=kolonne, Wrap=True)
preview_3 = CustomPreview(Geometry=incurves.Point, Material=ColourSwatch(SwatchColor=RGB(108, 111, 112)))
item_18 = ListItem(List=flatten(item_17), Index=række, Wrap=True)
preview_4 = CustomPreview(Geometry=item_18, Material=ColourSwatch(SwatchColor=RGB(2, 243, 247)))

python = GhPythonScript(x=[item_16, item_13, item_14, item_15])  # -> out, y
# ---------- python: Python ----------
__author__ = "martina"

import rhinoscriptsyntax as rs

y = False
if x == 0:
    y = -1
elif x == 2:
    y = 0
elif x == 1:
    y = 1
# ---------- end python ----------
panel_6 = Panel(python.y)
python_2 = GhPythonScript(x=flatten(panel_6))  # -> out, int; inputs x: list
# ---------- python_2: Python ----------
__author__ = "martina"

import rhinoscriptsyntax as rs

if '-1' not in x:
    num = ''.join(x)
    int_ = int(num, 2)
elif '-1' in x:
    int_ = -1
# ---------- end python_2 ----------

# ---- group: wall code
panel_7 = Panel(python_2.int)

# ----
# 1.
# 2.
panel_8 = Panel(values_2.Values)
toggle_7 = BooleanToggle(False)
toggle_8 = BooleanToggle(False)
toggle_9 = BooleanToggle(False)
panel_9 = Panel("25")
panel_10 = Panel("20")
place_clt_slabs = GhPythonScript(
    slabs=merge_2,
    grid=incurves.Index,
    sgrid=incurves_2.Relationship,
    folder_path=panel_8,
    grid_name="gridRevit",
    slabs_name="slabsRevit",
    sgrid_name="sgridRevit",
    fingrid_name="fingridRevit",
    numGenerations=values_8.Values,
    popSize=values_9.Values,
    mutateBeams=values_7.Values,
    write=values_5.Values,
    run=values_6.Values)  # -> out; inputs slabs: tree, grid: tree, sgrid: tree
# ---------- place_clt_slabs: Python ----------
__author__ = "martina"

import rhinoscriptsyntax as rs
import json
import os
import sys
import subprocess
import time

if write:
    slabs = [list(b) for b in slabs.Branches]
    
    grid = [list(b) for b in grid.Branches]
    
    sgrid = [list(b) for b in sgrid.Branches]
    
    
    slabFilePath = str(_folder_path) + "\\" + str(_slabs_name)+'.json'
    gridFilePath = str(_folder_path) +"\\" + str(_grid_name)+'.json'
    sgridFilePath = str(_folder_path) +"\\" + str(_sgrid_name)+'.json'
    
    
    
    with open(slabFilePath,'w') as myfile:
        json.dump(slabs,myfile)
        
    with open(gridFilePath,'w') as myfile:
        json.dump(grid,myfile)
        
    with open(sgridFilePath,'w') as myfile:
        json.dump(sgrid,myfile)
    print("Files written.")



if run:
    if not write:
        print("You have to write files first.")
    name = '\\fingridRevitGH.json'
    fingridFilePath = repr(_folder_path + name)
    GAPath = str(_folder_path) + '\\PyslabPlaceGA.py'
    if os.path.isfile(GAPath):
        print ("File exist")
        print("GA run began")
        numBestIndividuals = 1
        writeToFile = True
        #os.system("python GAPath -i " + str(numBestIndividuals) + " -g " + str(_numGenerations_) + " -p " + str(_popSize_) + " -b " + str(_mutateBeams_) + " -w " + str(writeToFile) + " -f " + str(fingridFilePath) + " -s " + slabFilePath + " -t" + gridFilePath + " -y " + sgridFilePath)
        subprocess.Popen(["python", 'C:\Users\marti\Documents\CN3 specialprojekt\RevitTests\PYslabPlaceGA.py', '-i', str(numBestIndividuals), '-g', str(_numGenerations_), '-p', str(_popSize_), "-b", str(_mutateBeams_),"-w",str(writeToFile)])
    else:
        print ("File path error. Check if 'PYslabPlaceGA.py' and 'WallsAndBeams.py' are located in folder.")
    
    
#
# ---------- end place_clt_slabs ----------
panel_11 = Panel(place_clt_slabs)

# ----
# visualize
listtotree = GhPythonScript(path=path, read=values_10.Values)  # -> out, tree
# ---------- listtotree: Python ----------
__author__ = "marti"
__version__ = "2021.03.25"

import rhinoscriptsyntax as rs
import Grasshopper as gh
import json



def load_json(path):
    with open(path) as f:
        data = json.load(f)
    return data[::-1]


def listToTree(nestedList):
    
    """ Convert a nested python iterable to a datatree 
        Credit: https://gist.github.com/piac """
    
    dt = gh.DataTree[object]()
    for i,l in enumerate(nestedList):
        dt.AddRange(l,gh.Kernel.Data.GH_Path(i))
        
    return dt

if read:
    nestedList = load_json(path)
    tree = listToTree(nestedList)
# ---------- end listtotree ----------
bnd = Bounds(Numbers=flatten(listtotree.tree))
dedomain_3 = DeconstructDomain(Domain=bnd)  # -> Start, End
dom = ConstructDomain(DomainStart="1", DomainEnd="255")
box = DomainBox(Base=PlaneXY(0, 0, 0), X=dom, Y=dom, Z=dom)
pop3d = Populate3D(Region=box, Count=dedomain_3.End, Seed=Slider(2, range=0..4))
pdecon = Deconstruct(Point=pop3d)  # -> XComponent, YComponent, ZComponent
rgb = ColourRGB(Alpha=255, Red=pdecon.XComponent, Green=pdecon.YComponent, Blue=pdecon.ZComponent)
merge_3 = Merge(Data1=" ", Data2=rgb)  # -> flatten(Result)
item_19 = ListItem(List=merge_3, Index=listtotree.tree, Wrap=Toggle(False))
preview_5 = CustomPreview(Geometry=ptfaces, Material=item_19)

# ----
# Display in Revit
sort = SortList(Keys=flatten(listtotree.tree))  # -> Keys, ValuesA
item_20 = ListItem(List=sort.Keys, Index="-1", Wrap=True)
flatten = FlattenTree(Tree=listtotree.tree, Path="{0}")
series = Series(Start="2", Step=1, Count=item_20)
panel_12 = Panel(flatten)
panel_13 = Panel(series)
mindex = MemberIndex(Set=panel_12, Member=panel_13)  # -> Index, Count
item_21 = ListItem(List=flatten(ptfaces), Index=mindex.Index, Wrap=True)
join_2 = BrepJoin(Breps=item_21)  # -> Breps, Closed
model_2 = ModelCategoriesPicker({"Air Systems": -2001008, "Air Terminals": -2008013, "Analysis Display Style": -2000304, "Analysis Results": -2000303, "Areas": -2003200, "Bridge Abutments": -2006130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}, selected="Generic Models": -2000151)
materials = QueryMaterials()
value_set_picker = ValueSetPicker(materials)
bygeometry = AddDirectShapeByGeometry(Name="CLT slabs", Category=model_2, Geometry=flatten(join_2.Breps), Material=flatten(value_set_picker))

settextblock = SetTextBlockContents(TextBlockToModify=tb, NewTextBlockContents=panel_11)
